# Grasshopper definition receiveAndStuff.gh (Grasshopper 0.9.76)
# plug-ins: gHowl

# ---- group: OSC READ
# based on gHowl example by Luis Fraguada
# also thanks goes to Andreas Schlegel for the oscP5 library
# 
# by Constantinos Miltiadis && Petros Koutsolampros
# Architecture School NTUA
port = Panel("3000")
netsource = NetworkSource()  # -> NetworkAdapterIsUp, AdapterProperties, LocalIpAddress
send_pattern_osc = Panel("999")
osc_addresses = Panel("/array")
udp = UDPReceiver(Port=port, Pattern=send_pattern_osc)  # -> Info, Data
osc_d = OSCDispatch(OSCDevices=osc_addresses, OSCMessage=udp.Data)  # -> OSCDevice, OSCData
message = Panel([udp.Info, udp.Data])
array = OSCChannel(OSCMessage=udp.Data)
osc_data = Panel(osc_d.OSCDevice)
osc_data_2 = Panel(osc_d.OSCData)
osc_data_3 = Panel(array)
split = StringSplit(String=osc_data_3, Separators="&")
split_2 = StringSplit(String=split, Separators="*")

# ----
pt = Point(split_2)
simplify = SimplifyTree(Tree=split_2, Front=False)
panel = Panel(simplify)
slider = Slider(0, range=0..7)
item = ListItem(List=simplify, Index=slider, Wrap=False)
flatten = FlattenTree(Data=item, Path="{0}")
panel_2 = Panel(flatten)
item_2 = ListItem(List=flatten, Index=slider, Wrap=False)
